# Grasshopper definition Sweep_Railing_Columns.gh (Grasshopper 1.0.7)
# plug-ins: HAL for Grasshopper

# railing
sessionsettings = SessionSettings()
crv = Curve([<curve referenced from the Rhino model> x205])  # disabled
# columns along railing
crv_2 = Curve([<curve referenced from the Rhino model> x4])
crv_3 = Curve(graft([<curve referenced from the Rhino model> x4]))
divide = DivideCurve(Curve=crv_2, Count="5", Kinks=False)  # -> Points, Tangents, Parameters
srf = Surface(<surface referenced from the Rhino model>)
end = EndPoints(Curve=crv_3)  # -> Start, End
panel = Panel("0.0005")  # disabled
len = Length(Curve=crv)  # disabled
pln = Plane(srf)
divide_2 = DivideCurve(Curve=crv_3, Count=10, Kinks=False)  # -> Points, Tangents, Parameters
srf_2 = Surface(<surface referenced from the Rhino model>)  # disabled
project = Project(Geometry=divide.Points, Plane=pln)  # -> Geometry, Transform
multiplication = Multiplication(A=len, B=panel)  # disabled
pln_2 = Plane(srf_2)  # disabled
item = ListItem(List=divide_2.Points, Index="-1", Wrap=True)
item_2 = ListItem(List=divide_2.Points, Index="-2", Wrap=True)
vec2pt = Vector2Pt(PointA=divide.Points, PointB=project.Geometry, Unitize=False)  # -> Vector, Length
ln = Line(StartPoint=divide.Points, EndPoint=project.Geometry)  # -> flatten(Line)
divide_3 = DivideCurve(Curve=crv, Count=multiplication, Kinks=False)  # -> Points, Tangents, Parameters; disabled
project_2 = Project(Geometry=divide_3.Points, Plane=pln_2)  # -> Geometry, Transform; disabled
vec2pt_2 = Vector2Pt(PointA=item_2, PointB=item, Unitize=False)  # -> Vector, Length
circle = CircleCNR(Center=item, Normal=vec2pt_2.Vector, Radius="1.5")
ln_2 = Line(StartPoint=divide_3.Points, EndPoint=project_2.Geometry)  # -> flatten(Line); disabled
vec2pt_3 = Vector2Pt(PointA=divide_3.Points, PointB=project_2.Geometry, Unitize=False)  # -> Vector, Length; disabled
swp1 = Sweep1(Rail=crv_3, Sections=circle, Miter=1)
circle_2 = CircleCNR(Center=divide.Points, Normal=vec2pt.Vector, Radius="1.5")
panel_2 = Panel("1.5")  # disabled
circle_3 = CircleCNR(Center=divide_3.Points, Normal=vec2pt_3.Vector, Radius=panel_2)  # disabled
extr = Extrude(Base=circle_2, Direction=vec2pt.Vector)
extr_2 = Extrude(Base=circle_3, Direction=ln_2)  # disabled
